# Grasshopper definition DUQ_Test.gh (Grasshopper 1.0.7)
# Copyright: Arup

# ---- group: Grid count
Y = Slider(16, range=2..40)
X = Slider(21, range=2..40)
Z = Slider(2, range=2..40)

# ---- group: Grid spacing
y = Slider(7.1, range=1..15)
z = Slider(1, range=1..15)
x = Slider(6.4, range=1..15)

# ----
num = Number(x)
int = Integer(X)
int_2 = Integer(Y)
int_3 = Integer(Z)
num_2 = Number(y)
num_3 = Number(z)
python = GhPythonScript(x=int, y=int_2, z=int_3, u=num, v=num_2, w=num_3)  # -> out, a, b
# ---------- python: Python ----------
import rhinoscriptsyntax as rs
from urllib import urlencode
import urllib2
import httplib
import json
import ast

__author__ = "aolux"
__version__ = "2022.08.23"

# Define the data
data = {"method":"reference","numx":x, "numy":y, "numz":z, "dimx":u, "dimy":v, "dimz":w}
data_json = json.dumps(data)

# Define the local port
url = '127.0.0.1:5000'

# Make the connection and send POST request as json
conn = httplib.HTTPConnection(url)
conn.request('POST', '/predict', data_json)
response = conn.getresponse()

# Receive data (as string) and convert to json
data = response.read() 
data = ast.literal_eval(data)

a = float(data["mean"])
b = float(data["sd"])
# ---------- end python ----------
python_2 = GhPythonScript(x=int, y=int_2, z=int_3, u=num, v=num_2, w=num_3)  # -> out, a, b
# ---------- python_2: Python ----------
import rhinoscriptsyntax as rs
from urllib import urlencode
import urllib2
import httplib
import json
import ast

__author__ = "aolux"
__version__ = "2022.08.23"

# Define the data
data = {"method":"MC","numx":x, "numy":y, "numz":z, "dimx":u, "dimy":v, "dimz":w}
data_json = json.dumps(data)

# Define the local port
url = '127.0.0.1:5000'

# Make the connection and send POST request as json
conn = httplib.HTTPConnection(url)
conn.request('POST', '/predict', data_json)
response = conn.getresponse()

# Receive data (as string) and convert to json
data = response.read() 
data = ast.literal_eval(data)

a = float(data["mean"])
b = float(data["sd"])
# ---------- end python_2 ----------
series = Series(Start=0, Step=num, Count=int)
series_2 = Series(Start=0, Step=num_2, Count=int_2)
series_3 = Series(Start=0, Step=num_3, Count=int_3)
frequency_true = Panel(python.a)
frequency = Panel(python_2.a)
uncertainty = Panel(python_2.b)
division = Division(A=uncertainty, B=frequency)
pt = ConstructPoint(XCoordinate=series, YCoordinate=graft(series_2), ZCoordinate=0)
Z_2 = UnitZ(Factor=series_3)
multiplication = Multiplication(A=division, B="100")
uncertainty_2 = Panel(multiplication)
flip = FlipMatrix(Data=pt)
move = Move(Geometry=graft(pt), Motion=Z_2)  # -> Geometry, Transform
pline = PolyLine(Vertices=pt, Closed=False)
pline_2 = PolyLine(Vertices=flip, Closed=False)
explode = Explode(Curve=pline, Recursive=True)  # -> Segments, Vertices
pline_3 = PolyLine(Vertices=move.Geometry, Closed=False)
explode_2 = Explode(Curve=pline_2, Recursive=True)  # -> Segments, Vertices
shift = ShiftList(List=Z_2, Shift=1, Wrap=False)
num_4 = Number(uncertainty_2)
tag = TextTag3D(Location=PlaneXY(-1.521014609, -1.954934756, 0), Text=frequency, Size=1, Justification=7)
subtraction = Subtraction(A=frequency, B=frequency_true)
frequency_error = Panel(subtraction)
division_2 = Division(A=subtraction, B=frequency_true)
multiplication_2 = Multiplication(A=division_2, B="100")
frequency_error_2 = Panel(multiplication_2)
larger = LargerThan(FirstNumber=uncertainty_2, SecondNumber=frequency_error_2)  # -> LargerThan, OrEqualTo

# ---- group: Change domain to suit
min_uncertainty = Panel("0")
max_uncertainty = Panel("30")

# ----
move_2 = Move(Geometry=graft(explode.Segments), Motion=shift)  # -> Geometry, Transform
move_3 = Move(Geometry=graft(explode_2.Segments), Motion=shift)  # -> Geometry, Transform
explode_3 = Explode(Curve=pline_3, Recursive=True)  # -> Segments, Vertices
trustworthy_prediction = Panel(larger.LargerThan)
gradient = Gradient(
    LowerLimit=min_uncertainty,
    UpperLimit=max_uncertainty,
    Parameter=num_4,
    stops=[0: RGB(0, 128, 0), 0.479: RGB(255, 255, 0), 1: RGB(255, 0, 0)])

# ---- group: beamsX
line = Line(move_2.Geometry)

# ---- group: beamsY
line_2 = Line(move_3.Geometry)

# ---- group: columnsZ
line_3 = Line(explode_3.Segments)

# ----
preview = CustomPreview(Geometry=[line, line_2, line_3], Material=gradient)
